# Grasshopper definition GearGenerator.gh (Grasshopper 1.0.7)
# plug-ins: Gear

pressure_angle = Slider(23.33, range=-1..35)
teeth = Slider(24, range=-1..30)
teeth_2 = Slider(14, range=-1..30)
crv = Curve(<curve referenced from the Rhino model>)
crv_2 = Curve(<curve referenced from the Rhino model>)
spurg = SpurGear(Circles=crv_2, Teeth=teeth_2, Angle=pressure_angle, Shift=0.1, Addendum=1, Dedendum=1.25)  # -> Gears, Pitch, Ratio
spurg_2 = SpurGear(Circles=crv, Teeth=teeth, Angle=pressure_angle, Shift=0.1, Addendum=1, Dedendum=1.25)  # -> Gears, Pitch, Ratio
